# Dynamo graph Bimorph Clash in Python v5.dyn (Dynamo 2.3.0.5885)
# Jeff Mercado Scripts - jayperson.mercado@gmail.com
# packages: bimorphNodes 3.0.3

python_script = Python()  # unwired: IN[0]
# ---------- python_script.python (9 lines) ----------
import sys
import clr
clr.AddReference('DSCoreNodes') 
import DSCore
from DSCore import *

webdata = DSCore.Web.WebRequestByUrl("https://raw.githubusercontent.com/jeffclassy/JeffMPyScripts/main/Main%20Element%20Clashes.py")

OUT = webdata
# ----------------------------------------
jeffm_python_script = PythonStringNode(script=python_script)  # frozen; unwired: IN[0]
python_script_2 = Python()
# ---------- python_script_2.python (9 lines) ----------
import sys
import clr
clr.AddReference('DSCoreNodes') 
import DSCore
from DSCore import *

webdata = DSCore.Web.WebRequestByUrl("https://raw.githubusercontent.com/jeffclassy/JeffMPyScripts/main/DS%20JM%20Ui.py")

OUT = webdata
# ----------------------------------------
python_script_3 = Python()  # unwired: IN[0]
# ---------- python_script_3.python (9 lines) ----------
import sys
import clr
clr.AddReference('DSCoreNodes') 
import DSCore
from DSCore import *

webdata = DSCore.Web.WebRequestByUrl("https://raw.githubusercontent.com/jeffclassy/JeffMPyScripts/main/Input_Tabs.py")

OUT = webdata
# ----------------------------------------
jeffm_python_script_2 = PythonStringNode(script=python_script_3)
code_block = CodeBlock { okbutton="Set Values"; run=true; title=""; logopath=""; help=null; cancelbutton="Cancel"; ht=0; wd=400; lblwd=160; }
jeffm_python_script_3 = PythonStringNode(script=python_script_2, IN[0]=jeffm_python_script_2, IN[1]=code_block.okbutton, IN[2]=code_block.run, IN[3]=code_block.title, IN[4]=code_block.logopath, IN[5]=code_block.help, IN[6]=code_block.cancelbutton, IN[7]=code_block.ht, IN[8]=code_block.wd, IN[9]=code_block.lblwd)
python_script_4 = Python(IN[0]=jeffm_python_script_3)
# ---------- python_script_4.python (134 lines) ----------
#Copyright JeffM Python Scripts
#jayperson.mercado@gmail.com
import sys
#sys.path.append(C....\bimorphNodes\bin')
#import os as os
import socket
import getpass
import math
host = socket.gethostname()
hostname = getpass.getuser()
import clr
clr.AddReference('ProtoGeometry')
from Autodesk.DesignScript.Geometry import *
from Autodesk.DesignScript.Geometry import Curve as GeomCurves
from Autodesk.DesignScript.Geometry import Solid as Sld
#from Autodesk.DesignScript.Geometry import Point as Pnt
#from Autodesk.DesignScript.Geometry import Vector as Vctr

clr.AddReference('System')
from System.Collections.Generic import List

clr.AddReference('RevitNodes')
import Revit
clr.ImportExtensions(Revit.GeometryConversion)
clr.ImportExtensions(Revit.Elements)

clr.AddReference('RevitAPI')
from Autodesk.Revit.DB import *

clr.AddReference('DSCoreNodes') 
from DSCore import Web as wb
from DSCore import String as strng

clr.AddReference('BimorphNodes')
from Revit import Element as Bimorph #, LinkElement
from Revit import LinkElement as LinkedBimorph
import Curve as BMCurve

# Import DocumentManager and TransactionManager
clr.AddReference("RevitServices")
import RevitServices
from RevitServices.Persistence import DocumentManager
from RevitServices.Transactions import TransactionManager

# Start Transaction
doc = DocumentManager.Instance.CurrentDBDocument
TransactionManager.Instance.EnsureInTransaction(doc)
solidlistA = List[Sld]()
curvelistB = List[BMCurve]()

def verif (d):
	if d[0] == host and d[1] == hostname and d[2] == chr(49):
		return True
def fixrotation (rot):
	if rot==180:
		rot=0
	elif rot>180:
		rot=abs(rot-360)
	else:
		rot
	return rot
def clash (arc,mep):
	try:		
		solidlistA.Add(Sld.ByUnion(arc.Solids))
		curvelistB.Add(mep.Location)
		intersect = BMCurve.SolidIntersection(solidlistA,curvelistB)
		solidlistA.Clear()
		curvelistB.Clear()
		#intersect = (Bimorph.IntersectsSolid((Sld.ByUnion(arc.Solids)),mep.Location,False))["Curve[]"]
	except:
		try:
			intersect = Geometry.Intersect(arcsolid,mep.Location)[0]
		except:
			intersect = None
	return intersect
		
def getmidpoint (crv):
	try:
		ptoi = GeomCurves.PointAtParameter(crv,0.5)
		return ptoi #point of intersection
	except:
		return crv

elementsListA = List[Revit.Elements.Element]()
elementsListB = List[Revit.Elements.Element]()

out=[]
run=IN[0][1]
rvtlinkinstance1=IN[0][0][0]
rvtlinkinstance2=IN[0][0][2]
ur1 = '19ZI50dVh_m5Azsb0D_ONsBIhEkziUk9hvK5LzJprY6k/edit?usp=sharing/'

category1=Revit.Elements.Category.ByName(IN[0][0][1])
category2=Revit.Elements.Category.ByName(IN[0][0][3])
arcelems=LinkedBimorph.OfCategory(rvtlinkinstance1,category1)
mepelems=LinkedBimorph.OfCategory(rvtlinkinstance2,category2)
url = 'https://docs.google.com/spreadsheets/d/'	
webdata = wb.WebRequestByUrl(url+ur1)
lctab = strng.Split(webdata,"\n")
for a in arcelems:
	elementsListA.Add(a)
for m in mepelems:
	elementsListB.Add(m)
lc=False
for line in lctab:
	if not strng.StartsWith(line,"<!DOCTYPE"):
		if strng.Contains(line,"\"><meta name="):
			if lc and (chr(106)+chr(101)+chr(102)+chr(102)+chr(99)+chr(108)+chr(97)+chr(115)+chr(115)+chr(121)) == (strng.Split(line,"\"><"))[0]:
				lc=True
			else:
				lc=False
		else:
			if verif(strng.Split(line,",")):
				lc=True
			
bimorphclash = Bimorph.IntersectsElement(elementsListA,elementsListB)# if lc else []
try:
	for a,m in zip(arcelems,bimorphclash["Element[][]"]):
		for n in m:
			try:
				#intersections = clash(a,n)
				#ptoi = getmidpoint(intersections)
				
				nunwrap = UnwrapElement(n)
				ntype = nunwrap.Document.GetElement(nunwrap.GetTypeId())		
				aunwrap = UnwrapElement(a)
				atype = aunwrap.Document.GetElement(aunwrap.GetTypeId())	
				out.append([a,n,atype,ntype])#,pointofintersection,rot])
			except:
				pass
except:
	out=[]
TransactionManager.Instance.TransactionTaskDone()
OUT = out
# ----------------------------------------
code_block_2 = CodeBlock { 0; 1; }
getItemAtIndex = List.GetItemAtIndex(list=python_script_4@L2, index=code_block_2.out0)
code_block_3 = CodeBlock(arc=getItemAtIndex) { arc[3100..4000]; }
getItemAtIndex_2 = List.GetItemAtIndex(list=python_script_4@L2, index=code_block_2.out1)
code_block_4 = CodeBlock(meps=getItemAtIndex_2) { meps[3100..4000]; }
python_script_5 = Python(IN[0]=code_block_3, IN[1]=code_block_4)
# ---------- python_script_5.python (85 lines) ----------
#Copyright JeffM Python Scripts
#jayperson.mercado@gmail.com
import sys
#sys.path.append(C....\bimorphNodes\bin')
#import os as os
import socket
import getpass
import math
host = socket.gethostname()
hostname = getpass.getuser()
import clr
clr.AddReference('ProtoGeometry')
from Autodesk.DesignScript.Geometry import *
from Autodesk.DesignScript.Geometry import Curve as GeomCurves
from Autodesk.DesignScript.Geometry import Solid as Sld
#from Autodesk.DesignScript.Geometry import Point as Pnt
#from Autodesk.DesignScript.Geometry import Vector as Vctr

clr.AddReference('System')
from System.Collections.Generic import List

clr.AddReference('RevitNodes')
import Revit
clr.ImportExtensions(Revit.GeometryConversion)
clr.ImportExtensions(Revit.Elements)

clr.AddReference('RevitAPI')
from Autodesk.Revit.DB import *

clr.AddReference('DSCoreNodes') 
from DSCore import Web as wb
from DSCore import String as strng

clr.AddReference('BimorphNodes')
from Revit import Element as Bimorph#, LinkElement
from Revit import LinkElement as LinkedBimorph
import Curve as BMCurve

# Import DocumentManager and TransactionManager
clr.AddReference("RevitServices")
import RevitServices
from RevitServices.Persistence import DocumentManager
from RevitServices.Transactions import TransactionManager

# Start Transaction
doc = DocumentManager.Instance.CurrentDBDocument
TransactionManager.Instance.EnsureInTransaction(doc)
solidlistA = List[Sld]()
curvelistB = List[GeomCurves]()
def clash (arc,mep):
			
	#solidlistA.Add(Sld.ByUnion(arc.Solids))
	#GeomCurves.TrimByEndParameter(mep.Location,0.001)
	mepgeom = GeomCurves.TrimByEndParameter(mep.Location,0.99)
	curvelistB.Add(mepgeom)
	intersect = BMCurve.SolidIntersection(Sld.ByUnion(arc.Solids),curvelistB)["Curve[]"]
	solidlistA.Clear()
	curvelistB.Clear()
		#intersect = (Bimorph.IntersectsSolid((Sld.ByUnion(arc.Solids)),mep.Location,False))["Curve[]"]
	return intersect
	
elementsListA = List[Revit.Elements.Element]()
elementsListB = List[Revit.Elements.Element]()
solidListA = List[Sld]()
solidlista = List[Sld]()
curvelistb = List[BMCurve]()
out=[]
run=IN[0][1]

arcelems=IN[0]
mepelems=IN[1]
for a in arcelems:
	elementsListA.Add(a)
for m in mepelems:
	elementsListB.Add(m)
			
#bimorphclash = Bimorph.IntersectsElement(elementsListA,elementsListB)# if lc else []

for a,b in zip(elementsListA,elementsListB):	
	#listsolid = Sld.ByUnion(a.Solids)
	out.append(clash(a,b))


TransactionManager.Instance.TransactionTaskDone()
OUT = out
# ----------------------------------------
solids = Revit.LinkElement.Solids(linkElement=code_block_3)
byUnion = Solid.ByUnion(solids=solids)
location = Revit.LinkElement.Location(linkElement=code_block_4)
solidIntersection = Curve.SolidIntersection(solid=byUnion, curves=location, lacing=Shortest)  # frozen
simplify = Curve.Simplify()  # unwired: curve, tolerance
trimByEndParameter = Curve.TrimByEndParameter()  # unwired: curve
