# Dynamo graph Create InterpolateGPS_V1.2_Dynamo-Sandbox File.dyn "Create InterpolateGPS_V1.2_Dynamo-Sandbox" (Dynamo 2.3.0.5885)
# Jeff Mercado Scripts * jayperson.mercado@gmail.com

excel_sheet = StringInput("Flight3")
excel_path = StringInput("C:\Users\jaypm.mercado\Downloads\xfire_-2021-11-16 Mapped.xlsx")
jeffM_fpv_InterpolateGPS_url = StringInput("https://raw.githubusercontent.com/jeffclassy/JeffMPyScripts/JeffM_FPV/InterpolateGPS_V1.2_Dynamo-Sandbox.py")
web_request = WebRequest(url=jeffM_fpv_InterpolateGPS_url)
file_from_path = FileObject(path=excel_path)
lat_lon_value_adjuster = IntegerSlider(5, range=3..10 step 1)
smooth_factor = IntegerSlider(2, range=1..25 step 1)
points_multiplier = IntegerSlider(4, range=1..20 step 1)
log_interval_in_seconds_1_1s_0 = DoubleInput(1)  # "Log Interval in Seconds. 1=1s, 0.001=1ms"
show_path = BoolSelector(true)
show_original_coordinates = BoolSelector(true)
show_interpolated_coordinates = BoolSelector(false)
export_to_excel = BoolSelector(false)
jeffM_FPV_Scripts = PythonStringNode(script=web_request, IN[0]=file_from_path, IN[1]=excel_sheet, IN[2]=lat_lon_value_adjuster, IN[3]=smooth_factor, IN[4]=points_multiplier, IN[5]=log_interval_in_seconds_1_1s_0, IN[6]=show_path, IN[7]=show_original_coordinates, IN[8]=show_interpolated_coordinates, IN[9]=export_to_excel)
code_block = CodeBlock(sheetname=excel_sheet, path=excel_path, data_out=jeffM_FPV_Scripts) { newsheet = sheetname + "_interp"; DSOffice.Data.ExportExcel(path, newsheet, 0, 0, (data_out[0]), true); }
